# Grasshopper definition Draft-munas.2.gh (Grasshopper 1.0.8)

curve = Curve([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])
curve_2 = Curve(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)
curve_3 = Curve([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])
bounding_box = BoundingBox(Content=curve, Plane=PlaneXY(0, 0, 0))  # -> Box, Box_2
curve_4 = Curve(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)
number_slider = Slider(80, range=0..100)
bounding_box_2 = BoundingBox(Content=curve_2, Plane=PlaneXY(0, 0, 0))  # -> Box, Box_2
area = Area(Geometry=curve)  # -> Area, Centroid
bounding_box_3 = BoundingBox(Content=curve_3, Plane=PlaneXY(0, 0, 0))  # -> Box, Box_2
area_2 = Area(Geometry=curve_3)  # -> Area, Centroid
area_3 = Area(Geometry=curve_2)  # -> Area, Centroid
boundary_surfaces = BoundarySurfaces(Edges=curve)
bounding_box_4 = BoundingBox(Content=curve_4, Plane=PlaneXY(0, 0, 0))  # -> Box, Box_2
area_4 = Area(Geometry=curve_4)  # -> Area, Centroid
populate_2d = Populate2D(Region=bounding_box.Box, Count=Slider(150, range=0..1000), Seed=1)
boundary_surfaces_2 = BoundarySurfaces(Edges=curve_2)
populate_2d_2 = Populate2D(Region=bounding_box_2.Box, Count=Slider(36, range=0..100), Seed=1)
boundary_surfaces_3 = BoundarySurfaces(Edges=curve_3)
populate_2d_3 = Populate2D(Region=bounding_box_3.Box, Count=Slider(150, range=0..1000), Seed=1)
boundary_surfaces_4 = BoundarySurfaces(Edges=curve_4)
populate_2d_4 = Populate2D(Region=bounding_box_4.Box, Count=Slider(36, range=0..100), Seed=1)
point_in_curve = PointInCurve(Point=populate_2d, Curve=boundary_surfaces)  # -> Relationship, Point
point_in_curve_2 = PointInCurve(Point=populate_2d_2, Curve=boundary_surfaces_2)  # -> Relationship, Point
point_in_curve_3 = PointInCurve(Point=populate_2d_3, Curve=boundary_surfaces_3)  # -> Relationship, Point
point_in_curve_4 = PointInCurve(Point=populate_2d_4, Curve=boundary_surfaces_4)  # -> Relationship, Point
equality = Equality(FirstNumber=point_in_curve.Relationship, SecondNumber="2")  # -> Equality, Inequality
equality_2 = Equality(FirstNumber=point_in_curve_2.Relationship, SecondNumber="2")  # -> Equality, Inequality
equality_3 = Equality(FirstNumber=point_in_curve_3.Relationship, SecondNumber="2")  # -> Equality, Inequality
equality_4 = Equality(FirstNumber=point_in_curve_4.Relationship, SecondNumber="2")  # -> Equality, Inequality
cull_pattern = CullPattern(List=point_in_curve_3.Point, CullPattern=equality_3.Equality)
cull_pattern_2 = CullPattern(List=point_in_curve.Point, CullPattern=equality.Equality)
cull_pattern_3 = CullPattern(List=point_in_curve_4.Point, CullPattern=equality_4.Equality)
cull_pattern_4 = CullPattern(List=point_in_curve_2.Point, CullPattern=equality_2.Equality)
point = Point([Point(-168.694604, 1947.492896, 0), Point(-166.5713597, 1878.487459, 0), Point(-180.3724471, 1735.168474, 0), Point(-162.3248713, 1630.067886, 0), Point(-142.1540513, 1461.269971, 0), Point(-390.5736243, 1162.954159, 0), Point(-269.5487041, 1037.68275, 0), Point(-168.694604, 926.2124288, 0), Point(-45.54643953, 1019.635174, 0), Point(69.10874804, 1149.153071, 0)])
points1 = Point([cull_pattern_2, cull_pattern])
point_2 = Point([Point(-168.694604, 1947.492896, 0), Point(-166.5713597, 1878.487459, 0), Point(-180.3724471, 1735.168474, 0), Point(-162.3248713, 1630.067886, 0), Point(-142.1540513, 1461.269971, 0), Point(-390.5736243, 1162.954159, 0), Point(-269.5487041, 1037.68275, 0), Point(-168.694604, 926.2124288, 0), Point(-45.54643953, 1019.635174, 0), Point(69.10874804, 1149.153071, 0)])
points1_2 = Point([cull_pattern_4, cull_pattern_3])

point_3 = Point([area_2.Centroid, area.Centroid])

curve_5 = Curve(<curve referenced from the Rhino model>)
area_5 = Area(Geometry=curve_5)  # -> Area, Centroid
number_slider_2 = Slider(0, range=0..100)

point_4 = Point([area_4.Centroid, area_3.Centroid])

distance = Distance(PointA=points1, PointB=point)
curve_6 = Curve(<curve referenced from the Rhino model>)
area_6 = Area(Geometry=curve_6)  # -> Area, Centroid
number_slider_3 = Slider(0, range=0..100)
distance_2 = Distance(PointA=points1_2, PointB=point_2)
construct_point = ConstructPoint(XCoordinate=number_slider_2, YCoordinate=number_slider_2, ZCoordinate=number_slider_2)
vector_2pt = Vector2Pt(PointA=area_5.Centroid, PointB=construct_point, Unitize=False)  # -> Vector, Length
move = Move(Geometry=curve_5, Motion=vector_2pt.Vector)  # -> Geometry, Transform
construct_point_2 = ConstructPoint(XCoordinate=number_slider_3, YCoordinate=number_slider_3, ZCoordinate=number_slider_3)
vector_2pt_2 = Vector2Pt(PointA=area_6.Centroid, PointB=construct_point_2, Unitize=False)  # -> Vector, Length
move_2 = Move(Geometry=curve_6, Motion=vector_2pt_2.Vector)  # -> Geometry, Transform
line = Line(StartPoint=area.Centroid, EndPoint=area_2.Centroid)
line_2 = Line(StartPoint=area_3.Centroid, EndPoint=area_4.Centroid)
move_3 = Move(Geometry=move.Geometry, Motion=points1)  # -> Geometry, Transform
move_4 = Move(Geometry=move_2.Geometry, Motion=points1_2)  # -> Geometry, Transform
expression = Expression(x=distance, A=Slider(2, range=0..10), k=Slider(0.5, range=0..1), Expression="A * sin(k * x)")
expression_2 = Expression(x=distance_2, A=Slider(2, range=0..10), k=Slider(0.5, range=0..1), Expression="A * sin(k * x)")
bounds = Bounds(Numbers=expression)
bounds_2 = Bounds(Numbers=expression_2)
remap_numbers = RemapNumbers(Value=expression, Source=bounds, Target="5 to 15")  # -> Mapped, Clipped
remap_numbers_2 = RemapNumbers(Value=expression_2, Source=bounds_2, Target="5 to 15")  # -> Mapped, Clipped
curve_7 = Curve([curve_3, curve])
curve_8 = Curve([curve_4, curve_2])
unit_z = UnitZ(Factor=remap_numbers.Mapped)
move_5 = Move(Geometry=points1, Motion=unit_z)  # -> Geometry, Transform
curve_closest_point = CurveClosestPoint(Point=move_5.Geometry, Curve=line)  # -> Point, Parameter, Distance
unit_z_2 = UnitZ(Factor=remap_numbers_2.Mapped)
move_6 = Move(Geometry=points1_2, Motion=unit_z_2)  # -> Geometry, Transform
curve_closest_point_2 = CurveClosestPoint(Point=move_6.Geometry, Curve=line_2)  # -> Point, Parameter, Distance
extrude_point = ExtrudePoint(Base=move_3.Geometry, Point=move_5.Geometry)

unit_x = UnitX(Factor=Slider(1, range=0..1))
vector_2pt_3 = Vector2Pt(PointA=points1, PointB=point_3, Unitize=False)  # -> Vector, Length
cross_product = CrossProduct(VectorA=unit_x, VectorB=vector_2pt_3.Vector, Unitize=False)  # -> Vector, Length
angle = Angle(VectorA=vector_2pt_3.Vector, VectorB=unit_x)  # -> Angle, Reflex
line_sdl = LineSDL(Start=points1, Direction=cross_product.Vector, Length=Slider(1, range=0..1))
rotate_axis = RotateAxis(Geometry=extrude_point, Angle=angle.Angle, Axis=line_sdl)  # -> Geometry, Transform

curve_closest_point_3 = CurveClosestPoint(Point=move_5.Geometry, Curve=curve_7)  # -> Point, Parameter, Distance
extrude_point_2 = ExtrudePoint(Base=move_4.Geometry, Point=move_6.Geometry)

unit_x_2 = UnitX(Factor=Slider(1, range=0..1))
vector_2pt_4 = Vector2Pt(PointA=points1_2, PointB=point_4, Unitize=False)  # -> Vector, Length
cross_product_2 = CrossProduct(VectorA=unit_x_2, VectorB=vector_2pt_4.Vector, Unitize=False)  # -> Vector, Length
angle_2 = Angle(VectorA=vector_2pt_4.Vector, VectorB=unit_x_2)  # -> Angle, Reflex
line_sdl_2 = LineSDL(Start=points1_2, Direction=cross_product_2.Vector, Length=Slider(1, range=0..1))
rotate_axis_2 = RotateAxis(Geometry=extrude_point_2, Angle=angle_2.Angle, Axis=line_sdl_2)  # -> Geometry, Transform

area_7 = Area(Geometry=rotate_axis.Geometry)  # -> Area, Centroid
curve_closest_point_4 = CurveClosestPoint(Point=move_6.Geometry, Curve=curve_8)  # -> Point, Parameter, Distance
bounds_3 = Bounds(Numbers=curve_closest_point.Distance)
area_8 = Area(Geometry=rotate_axis_2.Geometry)  # -> Area, Centroid
bounds_4 = Bounds(Numbers=curve_closest_point_2.Distance)
bounds_5 = Bounds(Numbers=curve_closest_point_3.Distance)
scale = Scale(Center=Point(0, 0, 0), Factor=0.5)  # -> Geometry, Transform
remap_numbers_3 = RemapNumbers(Value=curve_closest_point.Distance, Source=bounds_3, Target="0.3 to 1.6")  # -> Mapped, Clipped
bounds_6 = Bounds(Numbers=curve_closest_point_4.Distance)
remap_numbers_4 = RemapNumbers(Value=curve_closest_point_2.Distance, Source=bounds_4, Target="0.3 to 1.6")  # -> Mapped, Clipped
remap_numbers_5 = RemapNumbers(Value=curve_closest_point_3.Distance, Source=bounds_5, Target="0.3 to 1.8")  # -> Mapped, Clipped
remap_numbers_6 = RemapNumbers(Value=curve_closest_point_4.Distance, Source=bounds_6, Target="0.3 to 1.8")  # -> Mapped, Clipped
scale_2 = Scale(Geometry=rotate_axis.Geometry, Center=area_7.Centroid, Factor=remap_numbers_3.Mapped)  # -> Geometry, Transform
scale_3 = Scale(Geometry=rotate_axis_2.Geometry, Center=area_8.Centroid, Factor=remap_numbers_4.Mapped)  # -> Geometry, Transform
