# Grasshopper definition Draft0418.gh (Grasshopper 1.0.8)
# plug-ins: Kangaroo2 Components

number_slider = Slider(20, range=0..100)
number_slider_2 = Slider(30, range=0..100)
curve = Curve(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)
rectangle = Rectangle(Plane=PlaneXY(0, 0, 0), XSize=number_slider, YSize=number_slider, Radius=0)  # -> Rectangle, Length
multipipe = MultiPipe(NodeSize=0.5, EndOffset=1, StrutSize=1, Segment=0, KinkAngle=0.6, CubeFit=0, Caps=0)
rectangular_array = RectangularArray(Geometry=curve, Cell=rectangle.Rectangle, XCount=number_slider_2, YCount=number_slider_2)  # -> Geometry, Transform
curve_2 = Curve(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)
curve_3 = Curve(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)
area = Area(Geometry=rectangular_array.Geometry)  # -> Area, Centroid
curve_4 = Curve(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)
curve_5 = Curve(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)
curve_closest_point = CurveClosestPoint(Point=area.Centroid, Curve=[curve_4, curve_2])  # -> Point, Parameter, Distance
panel = Panel("""0.1
 to 0.9""")
curve_closest_point_2 = CurveClosestPoint(Point=area.Centroid, Curve=[curve_5, curve_3])  # -> Point, Parameter, Distance
number_slider_3 = Slider(1, range=0..1)
bounds = Bounds(Numbers=curve_closest_point.Distance)
distance = Distance()
bounds_2 = Bounds(Numbers=curve_closest_point_2.Distance)
remap_numbers = RemapNumbers(Value=curve_closest_point.Distance, Source=bounds, Target=panel)  # -> Mapped, Clipped
scale = Scale(Geometry=rectangular_array.Geometry, Center=area.Centroid, Factor=remap_numbers.Mapped)  # -> Geometry, Transform
remap_numbers_2 = RemapNumbers(Value=curve_closest_point_2.Distance, Source=bounds_2, Target="3 to 100")  # -> Mapped, Clipped
vector_xyz = VectorXYZ(XComponent=remap_numbers.Mapped, YComponent=remap_numbers.Mapped, ZComponent=0)  # -> Vector, Length
move = Move(Geometry=scale.Geometry, Motion=vector_xyz.Vector)  # -> Geometry, Transform
unit_z = UnitZ(Factor=remap_numbers_2.Mapped)
multipipe_2 = MultiPipe(Curves=move.Geometry, NodeSize=0.5, EndOffset=1, StrutSize=1, Segment=0, KinkAngle=0.6, CubeFit=0, Caps=0)
extrude = Extrude(Base=move.Geometry, Direction=unit_z)
cap_holes = CapHoles(Brep=extrude)
