# Grasshopper definition Design0.gh (Grasshopper 1.0.8)

width_x = Slider(48, range=0..1000)
height_y = Slider(52, range=0..1000)
bottom = Rectangle(Plane=PlaneXY(0, 0, 0), XSize=width_x, YSize=height_y, Radius=0)  # -> Rectangle, Length
number_horizontal_x_points = Slider(20, range=0..100)
explode = Explode(Curve=bottom.Rectangle, Recursive=True)  # -> Segments, Vertices
list_item = ListItem(List=explode.Segments, Index=Slider(0, range=-1..0), Wrap=True)
range = Range(Domain=Domain(0, 1), Steps=number_horizontal_x_points)
middle_curvature = GraphMapper(range, x0=0, x1=1, y0=0, y1=1, container_name="Gaussian", factor=0.2, mean=0.4887394607, sdev=0.1966192722)
divide_curve = DivideCurve(Curve=list_item, Count=number_horizontal_x_points, Kinks=False)  # -> Points, Tangents, Parameters
multiplication = Multiplication(A=height_y, B=middle_curvature)
multiplication_2 = Multiplication(A=height_y, B=Slider(0.95, range=0..10))
unit_y = UnitY(Factor=multiplication)
unit_y_2 = UnitY(Factor=multiplication_2)
middle_line = Move(Geometry=divide_curve.Points, Motion=unit_y)  # -> Geometry, Transform
number_verticle_y_points = Slider(29, range=0..100)
top_line = Move(Geometry=middle_line.Geometry, Motion=unit_y_2)  # -> Geometry, Transform
line = Line(StartPoint=top_line.Geometry, EndPoint=middle_line.Geometry)  # -> flatten(Line)
curve1 = Curve(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)
curve2 = Curve(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)
divide_curve_2 = DivideCurve(Curve=line, Count=number_verticle_y_points, Kinks=False)  # -> Points, Tangents, Parameters
curve_closest_point = CurveClosestPoint(Point=divide_curve_2.Points, Curve=curve2)  # -> Point, Parameter, Distance
curve_closest_point_2 = CurveClosestPoint(Point=divide_curve_2.Points, Curve=curve1)  # -> Point, Parameter, Distance
multiplication_3 = Multiplication(A=curve_closest_point_2.Distance, B=curve_closest_point.Distance)
bounds = Bounds(Numbers=multiplication_3)
remap_numbers = RemapNumbers(Value=multiplication_3, Source=bounds, Target=Domain(0, 1))  # -> Mapped, Clipped
extrusion_height = Slider(6, range=0..100)
graph_mapper = GraphMapper(
    remap_numbers.Mapped,
    x0=0,
    x1=1,
    y0=0,
    y1=1,
    container_name="Bezier",
    cpx=[0, 0.2088322341, 0.6610125303, 1],
    cpy=[0.4614731073, 0, 0, 0.3284748197])
multiplication_4 = Multiplication(A=extrusion_height, B=graph_mapper)
unit_z = UnitZ(Factor=multiplication_4)
top_points = Move(Geometry=divide_curve_2.Points, Motion=unit_z)  # -> Geometry, Transform
interpolate = Interpolate(Vertices=top_points.Geometry, Degree=3, Periodic=False, KnotStyle=1)  # -> flatten(Curve), Length, Domain
merge = Merge(Data1=graft(line), Data2=graft(interpolate.Curve))
multiplication_5 = Multiplication(A=width_x, B=Slider(1.05, range=0..10))
unit_x = UnitX(Factor=Slider(1.7, range=0..100))
loft = Loft(Curves=merge, Options={Adjust=False, Closed=False, LoftEnds=0, LoftSimp=0, LoftType=0, Rebuild=10, Refit=0.01})
number_slider = Slider(3, range=0..10)
extrude = Extrude(Base=loft, Direction=unit_x)
rectangle = Rectangle(Plane=PlaneXY(0, 0, 0), XSize=multiplication_5, YSize=height_y, Radius=0)  # -> Rectangle, Length
data_dam = DataDam(DataA=extrude, BufferDelay=10000000, BufferMode=0)
rectangular_array = RectangularArray(Geometry=data_dam, Cell=rectangle.Rectangle, XCount=number_slider, YCount=number_slider)  # -> Geometry, Transform
