# Grasshopper definition Design1_CircularWindows.gh (Grasshopper 1.0.8)

distance_between_elements = Slider(20, range=0..100)
number_of_rows_and_columns = Slider(24, range=0..100)
rectangle = Rectangle(Plane=PlaneXY(0, 0, 0), XSize=distance_between_elements, YSize=distance_between_elements, Radius=0)  # -> Rectangle, Length
shape = Curve(<curve referenced from the Rhino model>)
rectangular_array = RectangularArray(Geometry=shape, Cell=rectangle.Rectangle, XCount=number_of_rows_and_columns, YCount=number_of_rows_and_columns)  # -> Geometry, Transform
base_size = Curve(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)
area = Area(Geometry=rectangular_array.Geometry)  # -> Area, Centroid
curve = Curve(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)
curve_closest_point = CurveClosestPoint(Point=area.Centroid, Curve=base_size)  # -> Point, Parameter, Distance
panel = Panel("""0.1
 to 0.9""")
curve_closest_point_2 = CurveClosestPoint(Point=area.Centroid, Curve=curve)  # -> Point, Parameter, Distance
height_range = Panel("10 to 100")
bounds = Bounds(Numbers=curve_closest_point.Distance)
bounds_2 = Bounds(Numbers=curve_closest_point_2.Distance)
remap_numbers = RemapNumbers(Value=curve_closest_point.Distance, Source=bounds, Target=panel)  # -> Mapped, Clipped
scale = Scale(Geometry=rectangular_array.Geometry, Center=area.Centroid, Factor=remap_numbers.Mapped)  # -> Geometry, Transform
remap_numbers_2 = RemapNumbers(Value=curve_closest_point_2.Distance, Source=bounds_2, Target=height_range)  # -> Mapped, Clipped
vector_xyz = VectorXYZ(XComponent=remap_numbers.Mapped, YComponent=remap_numbers.Mapped, ZComponent=0)  # -> Vector, Length
move = Move(Geometry=scale.Geometry, Motion=vector_xyz.Vector)  # -> Geometry, Transform
unit_z = UnitZ(Factor=remap_numbers_2.Mapped)
multipipe = MultiPipe(Curves=move.Geometry, NodeSize=0.5, EndOffset=1, StrutSize=1, Segment=0, KinkAngle=0.6, CubeFit=0, Caps=0)
extrude = Extrude(Base=move.Geometry, Direction=unit_z)
cap_holes = CapHoles(Brep=extrude)
