# Grasshopper definition Design2.gh (Grasshopper 1.0.8)

distance_between_elements = Slider(60, range=0..100)
number_of_rows_and_columns = Slider(24, range=0..100)
rectangle = Rectangle(Plane=PlaneXY(0, 0, 0), XSize=distance_between_elements, YSize=distance_between_elements, Radius=0)  # -> Rectangle, Length
shape = Curve(<curve referenced from the Rhino model>)
rectangular_array = RectangularArray(Geometry=shape, Cell=rectangle.Rectangle, XCount=number_of_rows_and_columns, YCount=number_of_rows_and_columns)  # -> Geometry, Transform
area = Area(Geometry=rectangular_array.Geometry)  # -> Area, Centroid
curve = Curve(<curve referenced from the Rhino model>)
curve_2 = Curve(<curve referenced from the Rhino model>)
curve_closest_point = CurveClosestPoint(Point=area.Centroid, Curve=curve)  # -> Point, Parameter, Distance
panel = Panel("""0.1
 to 0.9""")
curve_closest_point_2 = CurveClosestPoint(Point=area.Centroid, Curve=curve_2)  # -> Point, Parameter, Distance
height_range = Panel("10 to 100")
bounds = Bounds(Numbers=curve_closest_point.Distance)
bounds_2 = Bounds(Numbers=curve_closest_point_2.Distance)
remap_numbers = RemapNumbers(Value=curve_closest_point.Distance, Source=bounds, Target=panel)  # -> Mapped, Clipped
scale = Scale(Geometry=rectangular_array.Geometry, Center=area.Centroid, Factor=remap_numbers.Mapped)  # -> Geometry, Transform
remap_numbers_2 = RemapNumbers(Value=curve_closest_point_2.Distance, Source=bounds_2, Target=height_range)  # -> Mapped, Clipped
vector_xyz = VectorXYZ(XComponent=remap_numbers.Mapped, YComponent=remap_numbers.Mapped, ZComponent=0)  # -> Vector, Length
move = Move(Geometry=scale.Geometry, Motion=vector_xyz.Vector)  # -> Geometry, Transform

area_2 = Area(Geometry=curve)  # -> Area, Centroid
unit_x = UnitX(Factor=Slider(1, range=0..1))
vector_2pt = Vector2Pt(PointA=area.Centroid, PointB=area_2.Centroid, Unitize=False)  # -> Vector, Length
cross_product = CrossProduct(VectorA=unit_x, VectorB=vector_2pt.Vector, Unitize=False)  # -> Vector, Length
angle = Angle(VectorA=vector_2pt.Vector, VectorB=unit_x)  # -> Angle, Reflex
line_sdl = LineSDL(Start=area_2.Centroid, Direction=cross_product.Vector, Length=Slider(1, range=0..1))
rotate_axis = RotateAxis(Geometry=move.Geometry, Angle=angle.Angle, Axis=line_sdl)  # -> Geometry, Transform

unit_z = UnitZ(Factor=remap_numbers_2.Mapped)
multipipe = MultiPipe(Curves=move.Geometry, NodeSize=0.5, EndOffset=1, StrutSize=1, Segment=0, KinkAngle=0.6, CubeFit=0, Caps=0)
data_dam = DataDam(DataA=rotate_axis.Geometry, BufferDelay=10000000, BufferMode=0)
extrude = Extrude(Base=data_dam, Direction=unit_z)
cap_holes = CapHoles(Brep=extrude)
solid_union = SolidUnion(Breps=cap_holes)
