# Grasshopper definition Task1 copy.gh (Grasshopper 1.0.8)

radius = Slider(62.127, range=0..70)
range = Range(Domain=Domain(0, 1), Steps=Slider(30, range=0..100))
graph_mapper = GraphMapper(range, x0=0, x1=1, y0=0, y1=1, container_name="Sine", Equation_px=[0.5112894177, 1], Equation_py=[0, 0.8217331171])
multiplication = Multiplication(A=range, B=radius)
petal_height = Slider(38.183, range=0..50)
multiplication_2 = Multiplication(A=graph_mapper, B=petal_height)
addition = Addition(A=Slider(0, range=0..100), B=multiplication)
construct_point = ConstructPoint(XCoordinate=multiplication_2, YCoordinate=addition, ZCoordinate=0)  # -> flatten(Point)
list_item = ListItem(List=construct_point, Index=Slider(-1, range=-1..1), Wrap=True)
interpolate = Interpolate(Vertices=construct_point, Degree=3, Periodic=False, KnotStyle=1)  # -> Curve, Length, Domain
deconstruct = Deconstruct(Point=list_item)  # -> XComponent, YComponent, ZComponent
mirror = Mirror(Geometry=interpolate.Curve, Plane=PlaneYZ(0, 0, 0))  # -> Geometry, Transform
unit_x = UnitX(Factor=deconstruct.XComponent)
multiplication_3 = Multiplication(A=unit_x, B=Slider(2, range=0..10))
move = Move(Geometry=mirror.Geometry, Motion=multiplication_3)  # -> Geometry, Transform

construct_domain = ConstructDomain(DomainStart=Slider(-1, range=-10..1), DomainEnd=Slider(1, range=0..1))
range_2 = Range(Domain=construct_domain, Steps=Slider(7, range=0..100))
expression = Expression(t=range_2, m=Slider(1, range=0..1), Expression="sin(t)*(sin(1/2*t))^(m)")
expression_2 = Expression(t=range_2, Expression="cos(t)")
construct_point_2 = ConstructPoint(XCoordinate=expression_2, YCoordinate=expression, ZCoordinate=0)
