# Grasshopper definition finaldesign.gh (Grasshopper 1.0.8)
# plug-ins: Kangaroo2 Components

curve_top = Curve(<curve referenced from the Rhino model>)
curve_middle = Curve(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)
curve_middle_side = Curve(<curve referenced from the Rhino model>)
number_for_the_middle_patt = Slider(288, range=0..1000)
number_slider = Slider(36, range=0..100)
number_for_the_top_part = Slider(166, range=0..1000)
bounding_box = BoundingBox(Content=curve_middle_side, Plane=PlaneXY(0, 0, 0))  # -> Box, Box_2
area = Area(Geometry=curve_middle_side)  # -> Area, Centroid
populate_2d = Populate2D(Region=bounding_box.Box, Count=number_for_the_middle_patt, Seed=1)
boundary_surfaces = BoundarySurfaces(Edges=curve_middle_side)
point_in_curve = PointInCurve(Point=populate_2d, Curve=boundary_surfaces)  # -> Relationship, Point
equality = Equality(FirstNumber=point_in_curve.Relationship, SecondNumber="2")  # -> Equality, Inequality
cull_pattern = CullPattern(List=point_in_curve.Point, CullPattern=equality.Equality)
curve_side_unit = Curve(<curve referenced from the Rhino model>)
unit_curve2 = Curve(<curve referenced from the Rhino model>)
unit_curve_2_1 = Curve(<curve referenced from the Rhino model>)
curve = Curve(<curve referenced from the Rhino model>)
point = Point(area.Centroid)
point_middle = Point(Point(43.541689, -353.2075692, 0))
points1 = Point(cull_pattern)
area_2 = Area(Geometry=curve_side_unit)  # -> Area, Centroid
distance = Distance(PointA=points1, PointB=point)
point_2 = Point(area.Centroid)
number_slider_2 = Slider(0, range=0..100)
construct_point = ConstructPoint(XCoordinate=number_slider_2, YCoordinate=number_slider_2, ZCoordinate=number_slider_2)
vector_2pt = Vector2Pt(PointA=area_2.Centroid, PointB=construct_point, Unitize=False)  # -> Vector, Length
move = Move(Geometry=curve_side_unit, Motion=vector_2pt.Vector)  # -> Geometry, Transform
unit_x = UnitX(Factor=Slider(1, range=0..1))
vector_2pt_2 = Vector2Pt(PointA=points1, PointB=point_2, Unitize=False)  # -> Vector, Length
expression = Expression(x=distance, A=Slider(2, range=0..10), k=Slider(0.5, range=0..1), Expression="A * sin(k * x)")
move_2 = Move(Geometry=move.Geometry, Motion=points1)  # -> Geometry, Transform
bounds = Bounds(Numbers=expression)
cross_product = CrossProduct(VectorA=unit_x, VectorB=vector_2pt_2.Vector, Unitize=False)  # -> Vector, Length
curve_middle_2 = Curve(<curve referenced from the Rhino model>)
angle = Angle(VectorA=vector_2pt_2.Vector, VectorB=unit_x)  # -> Angle, Reflex
curve_2 = Curve(<curve referenced from the Rhino model>)
remap_numbers = RemapNumbers(Value=expression, Source=bounds, Target="5 to 15")  # -> Mapped, Clipped
unit_z = UnitZ(Factor=remap_numbers.Mapped)
line_sdl = LineSDL(Start=points1, Direction=cross_product.Vector, Length=Slider(1, range=0..1))
move_3 = Move(Geometry=points1, Motion=unit_z)  # -> Geometry, Transform
curve_3 = Curve(curve_middle_side)
curve_closest_point = CurveClosestPoint(Point=move_3.Geometry, Curve=curve_2)  # -> Point, Parameter, Distance
curve_closest_point_2 = CurveClosestPoint(Point=move_3.Geometry, Curve=curve_3)  # -> Point, Parameter, Distance
panel = Panel("""0.3
 to 0.7""")
bounds_2 = Bounds(Numbers=curve_closest_point.Distance)
extrude = Extrude(Base=move_2.Geometry, Direction=unit_z)
bounds_3 = Bounds(Numbers=curve_closest_point_2.Distance)
extrude_point = ExtrudePoint(Base=move_2.Geometry, Point=move_3.Geometry)
rotate_axis = RotateAxis(Geometry=extrude_point, Angle=angle.Angle, Axis=line_sdl)  # -> Geometry, Transform
area_3 = Area(Geometry=rotate_axis.Geometry)  # -> Area, Centroid
remap_numbers_2 = RemapNumbers(Value=curve_closest_point.Distance, Source=bounds_2, Target=panel)  # -> Mapped, Clipped
number_slider_3 = Slider(90, range=0..100)
cap_holes = CapHoles(Brep=extrude)
remap_numbers_3 = RemapNumbers(Value=curve_closest_point_2.Distance, Source=bounds_3, Target="0.3 to 1.8")  # -> Mapped, Clipped
scale = Scale(Geometry=rotate_axis.Geometry, Center=points1, Factor=remap_numbers_2.Mapped)  # -> Geometry, Transform

curve_top_2 = Curve(<curve referenced from the Rhino model>)
number_middle_middle = Slider(48, range=0..100)
number_for_the_top_patt = Slider(288, range=0..1000)
number_for_the_top_part_2 = Slider(166, range=0..1000)
curve_middle_middle = Curve(<curve referenced from the Rhino model>)
bounding_box_2 = BoundingBox(Content=curve_top_2, Plane=PlaneXY(0, 0, 0))  # -> Box, Box_2
area_4 = Area(Geometry=curve_top_2)  # -> Area, Centroid
boundary_surfaces_2 = BoundarySurfaces(Edges=curve_top_2)
populate_2d_2 = Populate2D(Region=bounding_box_2.Box, Count=number_for_the_top_patt, Seed=Slider(1000, range=0..1000))
point_in_curve_2 = PointInCurve(Point=populate_2d_2, Curve=boundary_surfaces_2)  # -> Relationship, Point
equality_2 = Equality(FirstNumber=point_in_curve_2.Relationship, SecondNumber="2")  # -> Equality, Inequality
cull_pattern_2 = CullPattern(List=point_in_curve_2.Point, CullPattern=equality_2.Equality)
curve_top_unit = Curve(<curve referenced from the Rhino model>)
point_3 = Point(area_4.Centroid)
point_middle_2 = Point(Point(43.541689, -353.2075692, 0))
points1_2 = Point(cull_pattern_2)
area_5 = Area(Geometry=curve_top_unit)  # -> Area, Centroid
distance_2 = Distance(PointA=points1_2, PointB=point_3)
point_4 = Point(area_4.Centroid)
number_slider_4 = Slider(0, range=0..100)
construct_point_2 = ConstructPoint(XCoordinate=number_slider_4, YCoordinate=number_slider_4, ZCoordinate=number_slider_4)
vector_2pt_3 = Vector2Pt(PointA=area_5.Centroid, PointB=construct_point_2, Unitize=False)  # -> Vector, Length
move_4 = Move(Geometry=curve_top_unit, Motion=vector_2pt_3.Vector)  # -> Geometry, Transform
unit_x_2 = UnitX(Factor=Slider(1, range=0..1))
vector_2pt_4 = Vector2Pt(PointA=points1_2, PointB=point_4, Unitize=False)  # -> Vector, Length
expression_2 = Expression(x=distance_2, A=Slider(2, range=0..10), k=Slider(0.5, range=0..1), Expression="A * sin(k * x)")
move_5 = Move(Geometry=move_4.Geometry, Motion=points1_2)  # -> Geometry, Transform
bounds_4 = Bounds(Numbers=expression_2)
cross_product_2 = CrossProduct(VectorA=unit_x_2, VectorB=vector_2pt_4.Vector, Unitize=False)  # -> Vector, Length
curve_middle_3 = Curve(<curve referenced from the Rhino model>)
angle_2 = Angle(VectorA=vector_2pt_4.Vector, VectorB=unit_x_2)  # -> Angle, Reflex
remap_numbers_4 = RemapNumbers(Value=expression_2, Source=bounds_4, Target="5 to 15")  # -> Mapped, Clipped
curve_4 = Curve(<curve referenced from the Rhino model>)
unit_z_2 = UnitZ(Factor=remap_numbers_4.Mapped)
line_sdl_2 = LineSDL(Start=points1_2, Direction=cross_product_2.Vector, Length=Slider(1, range=0..1))
move_6 = Move(Geometry=points1_2, Motion=unit_z_2)  # -> Geometry, Transform
curve_5 = Curve(curve_top_2)
curve_closest_point_3 = CurveClosestPoint(Point=move_6.Geometry, Curve=curve_4)  # -> Point, Parameter, Distance
curve_closest_point_4 = CurveClosestPoint(Point=move_6.Geometry, Curve=curve_4)  # -> Point, Parameter, Distance
panel_2 = Panel("""0.2

 to 0.7""")
bounds_5 = Bounds(Numbers=curve_closest_point_3.Distance)
extrude_2 = Extrude(Base=move_5.Geometry, Direction=unit_z_2)
bounds_6 = Bounds(Numbers=curve_closest_point_4.Distance)
remap_numbers_5 = RemapNumbers(Value=curve_closest_point_3.Distance, Source=bounds_5, Target=panel_2)  # -> Mapped, Clipped
cap_holes_2 = CapHoles(Brep=extrude_2)
rotate_axis_2 = RotateAxis(Geometry=cap_holes_2, Angle=angle_2.Angle, Axis=line_sdl_2)  # -> Geometry, Transform
remap_numbers_6 = RemapNumbers(Value=curve_closest_point_4.Distance, Source=bounds_6, Target="0.3 to 1.8")  # -> Mapped, Clipped
scale_2 = Scale(Geometry=rotate_axis_2.Geometry, Center=points1_2, Factor=remap_numbers_5.Mapped)  # -> Geometry, Transform

width_x = Slider(48, range=0..1000)
height_y = Slider(52, range=0..1000)
bottom = Rectangle(Plane=PlaneXY(0, 0, 0), XSize=width_x, YSize=height_y, Radius=0)  # -> Rectangle, Length
number_horizontal_x_points = Slider(20, range=0..100)
explode = Explode(Curve=bottom.Rectangle, Recursive=True)  # -> Segments, Vertices
list_item = ListItem(List=explode.Segments, Index=Slider(0, range=-1..0), Wrap=True)
range = Range(Domain=Domain(0, 1), Steps=number_horizontal_x_points)
middle_curvature = GraphMapper(range, x0=0, x1=1, y0=0, y1=1, container_name="Gaussian", factor=0.2, mean=0.4887394607, sdev=0.1966192722)
divide_curve = DivideCurve(Curve=list_item, Count=number_horizontal_x_points, Kinks=False)  # -> Points, Tangents, Parameters
multiplication = Multiplication(A=height_y, B=middle_curvature)
multiplication_2 = Multiplication(A=height_y, B=Slider(0.95, range=0..10))
unit_y = UnitY(Factor=multiplication)
unit_y_2 = UnitY(Factor=multiplication_2)
middle_line = Move(Geometry=divide_curve.Points, Motion=unit_y)  # -> Geometry, Transform
number_verticle_y_points = Slider(29, range=0..100)
top_line = Move(Geometry=middle_line.Geometry, Motion=unit_y_2)  # -> Geometry, Transform
line = Line(StartPoint=top_line.Geometry, EndPoint=middle_line.Geometry)  # -> flatten(Line)
curve1 = Curve(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)
curve2 = Curve(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)
divide_curve_2 = DivideCurve(Curve=line, Count=number_verticle_y_points, Kinks=False)  # -> Points, Tangents, Parameters
curve_closest_point_5 = CurveClosestPoint(Point=divide_curve_2.Points, Curve=curve2)  # -> Point, Parameter, Distance
curve_closest_point_6 = CurveClosestPoint(Point=divide_curve_2.Points, Curve=curve1)  # -> Point, Parameter, Distance
multiplication_3 = Multiplication(A=curve_closest_point_6.Distance, B=curve_closest_point_5.Distance)
bounds_7 = Bounds(Numbers=multiplication_3)
curve_6 = Curve(<curve referenced from the Rhino model>)
remap_numbers_7 = RemapNumbers(Value=multiplication_3, Source=bounds_7, Target=Domain(0, 1))  # -> Mapped, Clipped
extrusion_height = Slider(6, range=0..100)
graph_mapper = GraphMapper(
    remap_numbers_7.Mapped,
    x0=0,
    x1=1,
    y0=0,
    y1=1,
    container_name="Bezier",
    cpx=[0, 0.2088322341, 0.6610125303, 1],
    cpy=[0.4614731073, 0, 0, 0.3284748197])
curve_closest_point_7 = CurveClosestPoint(Point=flatten(divide_curve_2.Points), Curve=curve_6)  # -> Point, Parameter, Distance
multiplication_4 = Multiplication(A=extrusion_height, B=graph_mapper)
bounds_8 = Bounds(Numbers=curve_closest_point_7.Distance)
unit_z_3 = UnitZ(Factor=multiplication_4)
top_points = Move(Geometry=divide_curve_2.Points, Motion=unit_z_3)  # -> Geometry, Transform
remap_numbers_8 = RemapNumbers(Value=curve_closest_point_7.Distance, Source=bounds_8, Target="0.9 to 1.7")  # -> Mapped, Clipped
interpolate = Interpolate(Vertices=top_points.Geometry, Degree=3, Periodic=False, KnotStyle=1)  # -> flatten(Curve), Length, Domain
number_slider_5 = Slider(1.7, range=0..100)
unit_x_3 = UnitX(Factor=remap_numbers_8.Mapped)
merge = Merge(Data1=graft(line), Data2=graft(interpolate.Curve))
multiplication_5 = Multiplication(A=width_x, B=Slider(1.05, range=0..10))
loft = Loft(Curves=merge, Options={Adjust=False, Closed=False, LoftEnds=0, LoftSimp=0, LoftType=0, Rebuild=10, Refit=0.01})
number_slider_6 = Slider(6, range=0..10)
extrude_3 = Extrude(Base=loft, Direction=unit_x_3)
rectangle = Rectangle(Plane=PlaneXY(0, 0, 0), XSize=multiplication_5, YSize=height_y, Radius=0)  # -> Rectangle, Length
data_dam = DataDam(DataDataA=extrude_3, BufferDelay=10000000, BufferMode=0)
rectangular_array = RectangularArray(Geometry=data_dam, Cell=rectangle.Rectangle, XCount=number_slider_6, YCount=number_slider_6)  # -> Geometry, Transform

# ---- group: middle middle design
curve_top_3 = Curve(<curve referenced from the Rhino model>)
curve_middle_4 = Curve(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)
curve_middle_side_2 = Curve(<curve referenced from the Rhino model>)
number_middle_middle_2 = Slider(48, range=0..100)
number_for_the_middle_patt_2 = Slider(288, range=0..1000)
curve_middle_top = Curve(<curve referenced from the Rhino model>)
number_for_the_top_part_3 = Slider(166, range=0..1000)
curve_middle_middle_2 = Curve(<curve referenced from the Rhino model>)
bounding_box_3 = BoundingBox(Content=curve_middle_top, Plane=PlaneXY(0, 0, 0))  # -> Box, Box_2
area_6 = Area(Geometry=curve_middle_top)  # -> Area, Centroid
boundary_surfaces_3 = BoundarySurfaces(Edges=curve_middle_top)
populate_2d_3 = Populate2D(Region=bounding_box_3.Box, Count=number_middle_middle_2, Seed=Slider(1000, range=0..1000))
point_in_curve_3 = PointInCurve(Point=populate_2d_3, Curve=boundary_surfaces_3)  # -> Relationship, Point
equality_3 = Equality(FirstNumber=point_in_curve_3.Relationship, SecondNumber="2")  # -> Equality, Inequality
curve_side_unit_2 = Curve(<curve referenced from the Rhino model>)
cull_pattern_3 = CullPattern(List=point_in_curve_3.Point, CullPattern=equality_3.Equality)
unit_curve2_2 = Curve(<curve referenced from the Rhino model>)
unit_curve_2_1_2 = Curve(<curve referenced from the Rhino model>)
curve_7 = Curve(<curve referenced from the Rhino model>)
point_5 = Point(area_6.Centroid)
point_middle_3 = Point(Point(43.541689, -353.2075692, 0))
points1_3 = Point(cull_pattern_3)
area_7 = Area(Geometry=curve_side_unit_2)  # -> Area, Centroid
distance_3 = Distance(PointA=points1_3, PointB=point_5)
point_6 = Point(area_6.Centroid)
number_slider_7 = Slider(0, range=0..100)
construct_point_3 = ConstructPoint(XCoordinate=number_slider_7, YCoordinate=number_slider_7, ZCoordinate=number_slider_7)
vector_2pt_5 = Vector2Pt(PointA=area_7.Centroid, PointB=construct_point_3, Unitize=False)  # -> Vector, Length
move_7 = Move(Geometry=curve_side_unit_2, Motion=vector_2pt_5.Vector)  # -> Geometry, Transform
unit_x_4 = UnitX(Factor=Slider(1, range=0..1))
vector_2pt_6 = Vector2Pt(PointA=points1_3, PointB=point_6, Unitize=False)  # -> Vector, Length
expression_3 = Expression(x=distance_3, A=Slider(2, range=0..10), k=Slider(0.5, range=0..1), Expression="A * sin(k * x)")
move_8 = Move(Geometry=move_7.Geometry, Motion=points1_3)  # -> Geometry, Transform
bounds_9 = Bounds(Numbers=expression_3)
cross_product_3 = CrossProduct(VectorA=unit_x_4, VectorB=vector_2pt_6.Vector, Unitize=False)  # -> Vector, Length
curve_middle_5 = Curve(<curve referenced from the Rhino model>)
angle_3 = Angle(VectorA=vector_2pt_6.Vector, VectorB=unit_x_4)  # -> Angle, Reflex
remap_numbers_9 = RemapNumbers(Value=expression_3, Source=bounds_9, Target="5 to 15")  # -> Mapped, Clipped
curve_8 = Curve(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)
unit_z_4 = UnitZ(Factor=remap_numbers_9.Mapped)
line_sdl_3 = LineSDL(Start=points1_3, Direction=cross_product_3.Vector, Length=Slider(1, range=0..1))
move_9 = Move(Geometry=points1_3, Motion=unit_z_4)  # -> Geometry, Transform
curve_9 = Curve(curve_middle_top)
curve_closest_point_8 = CurveClosestPoint(Point=move_9.Geometry, Curve=curve_8)  # -> Point, Parameter, Distance
curve_closest_point_9 = CurveClosestPoint(Point=move_9.Geometry, Curve=curve_9)  # -> Point, Parameter, Distance
panel_3 = Panel("""0.3
 to 0.7""")
bounds_10 = Bounds(Numbers=curve_closest_point_8.Distance)
extrude_point_2 = ExtrudePoint(Base=move_8.Geometry, Point=move_9.Geometry)
rotate_axis_3 = RotateAxis(Geometry=extrude_point_2, Angle=angle_3.Angle, Axis=line_sdl_3)  # -> Geometry, Transform
extrude_4 = Extrude(Base=move_8.Geometry, Direction=unit_z_4)
bounds_11 = Bounds(Numbers=curve_closest_point_9.Distance)
area_8 = Area(Geometry=rotate_axis_3.Geometry)  # -> Area, Centroid
remap_numbers_10 = RemapNumbers(Value=curve_closest_point_8.Distance, Source=bounds_10, Target=panel_3)  # -> Mapped, Clipped
number_slider_8 = Slider(90, range=0..100)
cap_holes_3 = CapHoles(Brep=extrude_4)
remap_numbers_11 = RemapNumbers(Value=curve_closest_point_9.Distance, Source=bounds_11, Target="0.3 to 1.8")  # -> Mapped, Clipped
scale_3 = Scale(Geometry=rotate_axis_3.Geometry, Center=points1_3, Factor=remap_numbers_10.Mapped)  # -> Geometry, Transform

# ---- group: draft
width_x_2 = Slider(48, range=0..1000)
height_y_2 = Slider(52, range=0..1000)
curve_10 = Curve(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)
bottom_2 = Rectangle(Plane=PlaneXY(0, 0, 0), XSize=width_x_2, YSize=height_y_2, Radius=0)  # -> Rectangle, Length
number_slider_9 = Slider(100, range=0..100)
number_horizontal_x_points_2 = Slider(60, range=0..100)
explode_2 = Explode(Curve=curve_10, Recursive=True)  # -> Segments, Vertices
list_item_2 = ListItem(List=explode_2.Segments, Index=Slider(0, range=-1..0), Wrap=True)
range_2 = Range(Domain=Domain(0, 1), Steps=number_slider_9)
middle_curvature_2 = GraphMapper(range_2, x0=0, x1=1, y0=0, y1=1, container_name="Gaussian", factor=0.2, mean=0.4887394607, sdev=0.1966192722)
divide_curve_3 = DivideCurve(Curve=list_item_2, Count=number_slider_9, Kinks=False)  # -> Points, Tangents, Parameters
multiplication_6 = Multiplication(A=height_y_2, B=middle_curvature_2)
multiplication_7 = Multiplication(A=height_y_2, B=Slider(0.95, range=0..10))
unit_y_3 = UnitY(Factor=multiplication_6)
middle_line_2 = Move(Geometry=divide_curve_3.Points, Motion=unit_y_3)  # -> Geometry, Transform
unit_y_4 = UnitY(Factor=multiplication_7)
top_line_2 = Move(Geometry=middle_line_2.Geometry, Motion=unit_y_4)  # -> Geometry, Transform
number_verticle_y_points_2 = Slider(29, range=0..100)
curve1_2 = Curve(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)
line_2 = Line(StartPoint=top_line_2.Geometry, EndPoint=middle_line_2.Geometry)  # -> flatten(Line)
curve2_2 = Curve(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)
divide_curve_4 = DivideCurve(Curve=line_2, Count=number_verticle_y_points_2, Kinks=False)  # -> Points, Tangents, Parameters
curve_closest_point_10 = CurveClosestPoint(Point=divide_curve_4.Points, Curve=curve2_2)  # -> Point, Parameter, Distance
curve_closest_point_11 = CurveClosestPoint(Point=divide_curve_4.Points, Curve=curve1_2)  # -> Point, Parameter, Distance
multiplication_8 = Multiplication(A=curve_closest_point_11.Distance, B=curve_closest_point_10.Distance)
bounds_12 = Bounds(Numbers=multiplication_8)
remap_numbers_12 = RemapNumbers(Value=multiplication_8, Source=bounds_12, Target=Domain(0, 1))  # -> Mapped, Clipped
extrusion_height_2 = Slider(6, range=0..100)
graph_mapper_2 = GraphMapper(
    remap_numbers_12.Mapped,
    x0=0,
    x1=1,
    y0=0,
    y1=1,
    container_name="Bezier",
    cpx=[0, 0.2088322341, 0.6610125303, 1],
    cpy=[0.4614731073, 0, 0, 0.3284748197])
multiplication_9 = Multiplication(A=extrusion_height_2, B=graph_mapper_2)
unit_z_5 = UnitZ(Factor=multiplication_9)
top_points_2 = Move(Geometry=divide_curve_4.Points, Motion=unit_z_5)  # -> Geometry, Transform
interpolate_2 = Interpolate(Vertices=top_points_2.Geometry, Degree=3, Periodic=False, KnotStyle=1)  # -> flatten(Curve), Length, Domain
merge_2 = Merge(Data1=graft([line_2, curve_10]), Data2=graft(interpolate_2.Curve))
unit_x_5 = UnitX(Factor=Slider(1.7, range=0..100))
loft_2 = Loft(Curves=merge_2, Options={Adjust=False, Closed=False, LoftEnds=0, LoftSimp=0, LoftType=0, Rebuild=10, Refit=0.01})
number_slider_10 = Slider(3, range=0..10)
extrude_5 = Extrude(Base=loft_2, Direction=unit_x_5)
data_dam_2 = DataDam(DataDataA=extrude_5, BufferDelay=10000000, BufferMode=0)

# ----
base_top = Curve(<curve referenced from the Rhino model>)
base_bottom = Curve(<curve referenced from the Rhino model>)
base_middle_1 = Curve(<curve referenced from the Rhino model>)
base_middle = Curve(<curve referenced from the Rhino model>)
number_slider_11 = Slider(1, range=0..10)
number_slider_12 = Slider(100, range=0..100)

# ---- group: Generating base shapes
divide_curve_5 = DivideCurve(Curve=base_middle_1, Count=Slider(100, range=0..100), Kinks=False)  # -> Points, Tangents, Parameters
divide_curve_6 = DivideCurve(Curve=base_middle_1, Count=Slider(100, range=0..100), Kinks=False)  # -> Points, Tangents, Parameters
surface = Surface(base_middle_1)
polyline = PolyLine(Vertices=divide_curve_5.Points, Closed=False)
shift_list = ShiftList(List=divide_curve_6.Points, Shift=1, Wrap=True)
line_3 = Line(StartPoint=divide_curve_6.Points, EndPoint=shift_list)
explode_3 = Explode(Curve=polyline, Recursive=True)  # -> Segments, Vertices
line_4 = Line(explode_3.Segments)
strengtsh = Slider(306, range=0..1000)
strength = Slider(19, range=0..100)
mesh_brep = MeshBrep(
    Brep=surface,
    Settings={GridMaxCount=0, GridMinCount=16, JaggedSeams=False, MaxEdgeLength=0, MinEdgeLength=0.0001, MinTolerance=0, Refine=True, RefineAngle=0, RelativeTolerance=0.65, SimplePlanes=True, Tolerance=0})
onmesh = OnMesh(Points=divide_curve_6.Points, Mesh=mesh_brep, Strength=strengtsh)
collider = Collider(Objects=[line_3, line_4], Radii=Slider(8.3, range=0..10), Strength=strength)
shift_list_2 = ShiftList(List=line_3, Shift=1, Wrap=True)
strength_2 = Slider(787, range=0..1000)
damp = Slider(0.822, range=0..1)
angle_4 = Slider(6, range=0..10)
angle_5 = Angle(LineA=line_3, LineB=shift_list_2, RestAngle=angle_4, Strength=strength_2)
degree = Slider(10, range=0..10)

# ----
length = Length(Curve=line_3)
addition = Addition(A=length, B=Slider(9.6, range=0..10))

# ---- group: Generating base shapes (continued)
length_line = LengthLine(Line=line_3, Length=addition, Strength=Slider(131, range=0..1000))
bouncysolver = BouncySolver(
    GoalObjects=flatten([onmesh, length_line, collider, angle_5]),
    Reset=Button(),
    Threshold=1e-15,
    Tolerance=0.0001,
    Damping=damp,
    Iterations=10,
    On=Toggle(True))  # -> I, V, O
nurbs_curve = NurbsCurve(Vertices=bouncysolver.V, Degree=degree, Periodic=True)  # -> Curve, Length, Domain
